# Grasshopper definition MocapDemo-garthz.gh (Grasshopper 0.9.76)
# plug-ins: Python Interpreter

# ----
# Mocap CSV File Loader
# Note: the Mocap CSV loader rotates
# the input data from the XZ ground plane
# convention of the Optitrack system
# to a XY Rhino ground plane convention.
path = FilePath("C:\Users\garthz\src\cmuphyscomp\hmv-s16\debugging\mocapdata\Cursor posing Gesture flicks 2016-02-04 11.09.27 AM.csv")
stride = Slider(1, range=1..20)
panel = Panel(path)
csv_loader = PythonScript(path=panel, stride=stride)  # -> out, names, planes
# ---------- csv_loader: Python ----------
# CSVLoader.py - the file loader script in the ghpython object in MocapDemo.gh.

# Demonstration of parsing an Optitrack motion capture CSV file.
#
# inputs
#   path    - string with the full path to the CSV file
#   stride  - the sequence interval between successive points; 1 returns all points, >1 subsamples
#
# outputs
#   out      - debugging text stream
#   names    - data tree of body names
#   planes   - data tree of Plane trajectories, one branch per rigid body, each leaf a list of Planes

# import the Optitrack file loader from the same folder
import optiload

# load the file
take = optiload.load_csv_file(path)

print "Found rigid bodies:", take.rigid_bodies.keys()

# emit all return values
names = take.rigid_bodies.keys()
planes = optiload.all_Planes(take, int(stride))
# ---------- end csv_loader ----------
panel_2 = Panel(csv_loader.planes)
panel_3 = Panel(csv_loader.out)
panel_4 = Panel(csv_loader.names)
viewer = ParamViewer(csv_loader.planes)

# ----
# Mocap Stream Receiver
# Note that the input Planes are rotated
# from Optitrack XZ ground plane convention
#  to Rhino XY ground plane conventions.
toggle = BooleanToggle(False)
timer = Timer(TimerInterval=50, Target=mocapreceiver)  # disabled
mocapreceiver = PythonScript(reset=toggle, version="2800")  # -> out, received, names, planes; inputs reset: Boolean
# ---------- mocapreceiver: Python ----------
# MocapReceiver.py - the motion capture script in the ghpython object in MocapDemo.gh

# Demonstration of receiving and parsing an Optitrack motion capture real-time stream.
# This is normally polled from a timer.
#
# inputs
#   reset   - Boolean flag to reset the receiver system
#   version - string defining the protocol version number (e.g. "2900" for Motive 1.9)
#
# outputs
#   out      - debugging text stream
#   received - integer number of new frames received
#   planes   - list of Plane objects or None, one per rigid body stream

# use persistent state context
import scriptcontext

# import the Optitrack stream receiver
# reload(optirecv)
import optirecv

# If the user reset input is set, then clear any existing state and do nothing.
if reset:
    print "Resetting receiver state."
    scriptcontext.sticky['mocap_port'] = None
 
else:
    # fetch or create the persistent motion capture streaming receiver port
    port = scriptcontext.sticky.get('mocap_port')
    if port is None:
        port = optirecv.OptitrackReceiver(version)
        scriptcontext.sticky['mocap_port'] = port

    # Poll the port as long as data is available, accumulating all
    # frames.  It is unlikely that Grasshopper will keep up with the
    # 120 Hz mocap sampling rate, butit is important to have the
    # continuous trajectory available for analysis and recording.
    receiving = True
    frames = list()
    while receiving:
        receiving = port.poll()
        if receiving:
            frames.append(port.make_plane_list())

    # Convert the frame list into a data tree for output.  As accumulated, it is a Python list of lists:
    # [[body1_sample0, body2_sample0, body3_sample0, ...], [body1_sample1, body2_sample1, body3_sample1, ...], ...]
    planes = optirecv.frames_to_tree(frames)
    received = len(frames)
    
    # Emit the list of body names in the order corresponding to the
    # branches in the trajectory data tree.  The ordering is stable as
    # determined by the configuration in the Motive project.
    names  = port.bodynames
# ---------- end mocapreceiver ----------
panel_5 = Panel(mocapreceiver.out)
panel_6 = Panel(mocapreceiver.received)
panel_7 = Panel(mocapreceiver.names)
panel_8 = Panel(mocapreceiver.planes)

# ----
# Mocap CSV File Player:
# stream trajectory segments
# to simulate live input
# select segment from
# full tree from file
# playback group size
rewind_playback = Button()
enable_playback = BooleanToggle(True)
size = Slider(12, range=1..20)
branch = TreeBranch(Tree=csv_loader.planes, Path="{0;0}", MaintainPaths=True)
lng = ListLength(List=branch)
timer_2 = Timer(TimerInterval=100, Target=counter)  # disabled
counter = PythonScript(name="playback_counter", enable=enable_playback, reset=rewind_playback, low=0, high=lng, step=size)  # -> out, value; inputs enable: Boolean, reset: Boolean, low: Int32, high: Int32, step: Int32
# ---------- counter: Python ----------
# Counter.py - general purpose counter block for use in ghpython object
# inputs
#  name   - counter name token string
#  enable - bool to enable counting
#  reset  - bool to reset to lowest value
#  low    - lowest output value
#  high   - upper bound on output value
#  step   - interval to step

# outputs
#   value - integer count value

import scriptcontext as sc

value = sc.sticky.get(name)

if value is None or reset or value >= high:
    value = low

elif enable:
    value = value + step

sc.sticky[name] = value
print value
# ---------- end counter ----------
subtraction = Subtraction(A=size, B=1)
int = Integer(counter.value)
addition = Addition(A=int, B=subtraction)
panel_9 = Panel(int)
dom = ConstructDomain(DomainStart=int, DomainEnd=addition)
subset = SubList(List=csv_loader.planes, Domain=dom, Wrap=False)  # -> List, Index
trim = TrimTree(Tree=subset.List, Depth=1)
panel_10 = Panel(trim)
viewer_2 = ParamViewer(trim)

# ----
# Select input source
# and divide trajectory streams
# divide mocap trajectory branches
# by body name in alphabetical order;
# this reduces dependence on the
# rigid body definition ordering.
# Select mocap data source:
# 0 for streaming, 1 for file
# Cursor
# Gesture
# Tool
# separate mocap stream by body
number_slider = Slider(1, range=0..1)
filter = StreamFilter(Gate=number_slider, Stream0=mocapreceiver.planes, Stream1=trim)
filter_2 = StreamFilter(Gate=number_slider, Stream1=csv_loader.planes)
filter_3 = StreamFilter(Gate=number_slider, Stream0=mocapreceiver.names, Stream1=csv_loader.names)
panel_11 = Panel(filter_3)
sortedpaths = PythonScript(names=filter_3)  # -> out, paths, p1, p2, p3; inputs names: list
# ---------- sortedpaths: Python ----------
# SortedPaths.py - contents of the ghpython object
# inputs
#  names - list of body names from a mocap stream

# outputs
#  paths - list of data tree paths in order sorted by name
#  Pn    - individual path

sorted_names = sorted(names)
indices = [names.index(name) for name in sorted_names]
paths = ["0;%d" % index for index in indices]

p1 = paths[0]
p2 = paths[1]
p3 = paths[2]
# ---------- end sortedpaths ----------
panel_12 = Panel(sortedpaths.paths)
branch_2 = TreeBranch(Tree=filter, Path=sortedpaths.p1, MaintainPaths=True)
branch_3 = TreeBranch(Tree=filter, Path=sortedpaths.p2, MaintainPaths=True)
branch_4 = TreeBranch(Tree=filter, Path=sortedpaths.p3, MaintainPaths=True)
viewer_3 = ParamViewer(branch_2)
viewer_4 = ParamViewer(branch_3)
viewer_5 = ParamViewer(branch_4)

# ----
# Display full Gesture track from file
item = ListItem(List=sortedpaths.paths, Index=1, Wrap=True)
branch_5 = TreeBranch(Tree=filter_2, Path=item, MaintainPaths=True)
deplane = DeconstructPlane(Plane=branch_5)  # -> Origin, XAxis, YAxis, ZAxis
multiplication = Multiplication(A=deplane.YAxis, B=0.2)
addition_2 = Addition(A=deplane.Origin, B=multiplication)
pt = Point(addition_2)
ln = Line(StartPoint=deplane.Origin, EndPoint=addition_2)

# ----
# show Cursor
# trajectory
xy = XYPlane(Origin=Point(0, 0, 0))
srf = Surface(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)
orient = Orient(Geometry=srf, Source=xy, Target=branch_2)  # -> Geometry, Transform
col = Colour(RGB(130, 0, 130))
preview = CustomPreview(Geometry=orient.Geometry, Shader=col)

# ----
# Gesture Event Detection
# Detect quick flicking motions
# acceleration threshold
# (smaller is more sensitive)
deplane_2 = DeconstructPlane(Plane=branch_3)  # -> Origin, XAxis, YAxis, ZAxis
threshold = Slider(126, range=100..300)
multiplication_2 = Multiplication(A=deplane_2.YAxis, B=0.2)
addition_3 = Addition(A=deplane_2.Origin, B=multiplication_2)
ln_2 = Line(StartPoint=deplane_2.Origin, EndPoint=addition_3)
pt_2 = Point(addition_3)
detectflick = PythonScript(reset=Button(), points=pt_2, threshold=threshold)  # -> out, sample, pos, accel; inputs points: list of Point3d
# ---------- detectflick: Python ----------
# DetectFlick.py - contents of the ghpython object in MocapDemo.gh
#
# inputs
#   reset   - Boolean to deactivate and reset state
#   points  - list of Point3D objects representing the path of the tip of an indicating stick
#             Note: the 'points' input must be set to 'List Access'
# threshold - the acceleration value above which to output an event

# outputs
#   out      - debugging text stream
#   sample   - None, or an integer sample offset for the flick event; zero is 'now', negative values are relative to now.
#   pos      - list of points in buffer
#  accel     - list of estimated accelerations

# use persistent state context
import scriptcontext
sc_identifier = 'flick_detector'

# use point filter with acceleration estimator
reload(pointfilter)
import pointfilter

# If the user reset input is set, then clear any existing state and do nothing.
if reset:
    print "Resetting receiver state."
    scriptcontext.sticky[sc_identifier] = None 

else:
    # fetch or create the persistent filter object
    filter = scriptcontext.sticky.get(sc_identifier)
    if filter is None:
        filter = pointfilter.Point3dFilter(80)
        scriptcontext.sticky[sc_identifier] = filter
        
    # add the new data
    filter.add_points(points)
    # print filter._position
    # print "Adding %d points to filter." % len(points)
    # offset, mag, acc, pos = filter.find_accel_peak()
    # print "Peak at %d of %f" % (offset, mag)
    
    sample = filter.detect_acceleration_event( threshold )
    if sample is not None:
        print "Acceleration peak observed at %d" % sample
    
    print "Filter has seen %d points, buffer starts at %d, blanking ends at %d." % (filter.samples, filter.samples - filter._buf_len, filter.last_event + filter.blanking)
    pos = filter._position
    accel = filter._accel
# ---------- end detectflick ----------
panel_13 = Panel(detectflick.out)
panel_14 = Panel(detectflick.sample)

# ----
# show Tool
# trajectory
cone = Cone(Base=PlaneXY(0, 0, 0), Radius=0.1, Length=0.2)  # -> Cone, Tip
xy_2 = XYPlane(Origin=Point(0, 0, 0))
orient_2 = Orient(Geometry=cone.Cone, Source=xy_2, Target=PlaneXY(0, 0, 0))  # -> Geometry, Transform

# ----
# Record Indicated Poses
# show indicated poses
erase = Button()
planerecord = PythonScript(inputs=branch_2, capture=detectflick.sample, clear=erase)  # -> out, planes; inputs inputs: list of Plane, capture: Int32, clear: Boolean
# ---------- planerecord: Python ----------
# PlaneRecord.py - the plane data recording script in the ghpython object in MocapDemo.gh.
#
# inputs
#  inputs   - list of Plane objects
#  capture  - None or integer sample time offset indicating which recent object should be added to the set
#  clear    - Boolean indicating the the data set should be erased
#  N.B. the 'inputs' input must be set to 'List Access'
#  N.B. the 'capture' input should have a type hint of Int

# other ideas:
#   path       - string with the full path to the CSV file
#   selection  - currently selected set

# outputs
#   out      - debugging text stream
#   planes   - list of Plane objects

# use RhinoCommon API
import Rhino

# use persistent state context
import scriptcontext

# use the history utility class
import historybuffer

################################################################
class PlaneRecorder(object):
    def __init__(self):
        # list of selected objects
        self.planes = []
 
        # keep track of about a quarter-second of mocap data
        self.buffer = historybuffer.History(30)
        return

    def add_planes(self, planes):
        if planes is not None:
            self.buffer.append(planes)
        return
    
    def capture_plane(self, offset):
        self.planes.append(self.buffer[offset])
        return

################################################################
if clear:
    # create an empty data recorder
    recorder = PlaneRecorder()
    scriptcontext.sticky['plane_recorder'] = recorder

else:
    # fetch or create a persistent data recorder
    recorder = scriptcontext.sticky.get('plane_recorder')
    if recorder is None:
        recorder = PlaneRecorder()
        scriptcontext.sticky['plane_recorder'] = recorder
    recorder.add_planes(inputs)

if capture is not None:
    recorder.capture_plane(capture)
 
planes = recorder.planes
print "Buffer has seen %d planes, currently holding %d selected planes." % (recorder.buffer.samples, len(planes))
# ---------- end planerecord ----------
pln = Plane(planerecord.planes)
xy_3 = XYPlane(Origin=Point(0, 0, 0))
panel_15 = Panel(planerecord.out)
srf_2 = Surface(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)
orient_3 = Orient(Geometry=srf_2, Source=xy_3, Target=pln)  # -> Geometry, Transform
panel_16 = Panel(pln)
col_2 = Colour(RGB(255, 0, 255))
preview_2 = CustomPreview(Geometry=orient_3.Geometry, Shader=col_2)
