# Grasshopper definition MocapDemo.gh (Grasshopper 0.9.76)
# plug-ins: Python Interpreter

timer = Timer(TimerInterval=20, Target=python)
# Mocap Stream Receiver
toggle = BooleanToggle(False)
python = PythonScript(reset=toggle, version="2900")  # -> out, received, position, orient, xaxis, yaxis; inputs reset: Boolean
# ---------- python: Python ----------
# Demonstration of receiving and parsing an Optitrack motion capture real-time stream.
# This is normally polled from a timer.
#
# inputs
#   reset   - Boolean flag to reset the receiver system
#   version - string defining the protocol version number (e.g. "2900" for Motive 1.9)
#
# outputs
#   out      - debugging text stream
#   received - flag true if new data was received
#   position - data tree of position tuples
#   orient   - data tree of quaternion tuples, orientations are (x,y,z,w) quaternions
#   xaxis    - data tree of X axis unit vectors (computed from orientations)
#   yaxis    - data tree of Y axis unit vectors (computed from orientations)

# use persistent state context
import scriptcontext

# import the Optitrack stream receiver
import optirecv

# If the user reset input is set, then clear any existing state and do nothing.
if reset:
    print "Resetting receiver state."
    scriptcontext.sticky['mocap_port'] = None
 
else:
   # fetch or create the persistent motion capture streaming receiver port
    port = scriptcontext.sticky.get('mocap_port')
    if port is None:
        port = optirecv.OptitrackReceiver(version)
        scriptcontext.sticky['mocap_port'] = port
    
    received = True
    while received:
        received = port.poll()
        
    # always set the output variables so the most recent values are available
    position, orient, xaxis, yaxis = port.make_data_trees()
# ---------- end python ----------
panel = Panel(python.out)
panel_2 = Panel(python.received)
pt2num = NumbersToPoints(Numbers=python.position, Mask=4)
pt2num_2 = NumbersToPoints(Numbers=python.yaxis, Mask=4)
pt2num_3 = NumbersToPoints(Numbers=python.xaxis, Mask=4)
bool = Boolean(python.received)
pt = Point(pt2num)
# Reconstruct object Planes
# from the origin and basis vectors.
# 
# The stream includes an origin and
# quaternion for each rigid body.
pt_2 = Point(pt2num_2)
pt_3 = Point(pt2num_3)
addition = Addition(A=pt, B=pt_3)
addition_2 = Addition(A=pt, B=pt_2)
panel_3 = Panel(python.position)
pl_3pt = Plane3Pt(PointA=pt, PointB=addition, PointC=addition_2)
pline = PolyLine(Vertices=[pt, addition, addition_2], Closed=False)
rec = DataRecorder(pline, DataLimit=-10, RecordData=False)
crv = Curve(rec)
panel_4 = Panel(crv)
